# Grasshopper definition Birdland-Python3.gh (Grasshopper 1.0.8)
# plug-ins: Robots

# COMPONENT STUDY: BIRDLAND / FOUR ROBOT DRUMMERS
# Read left to right. Each lane drives one arm.
playback_0_to_1 = Slider(0.3, range=0..1)
clip_length_seconds = Slider(75, range=5..75)
stick_mm = Panel("300")
presser_mm = Panel("100")
snare_seconds = Panel("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")
cymbal_seconds = Panel("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")
kick_seconds = Panel("18.5254,21.4581,31.6430,32.2815,36.9197,42.6870,42.9743,43.0643,44.4778,46.0016,47.5312,48.6835,49.0551,49.4527,49.8039,50.9446,52.4481,52.8370,53.6033,54.1605,55.1300,67.3408,69.7034,70.0662,70.3652,72.2663,73.0268,73.4070,74.9134")
hat_pedal_chart_groove = Panel("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")
snare_accents_seconds = Panel("42.2284,42.507,42.6841,42.9743,44.472,45.4444,45.9987,47.3484,48.4833,48.6777,49.0493,49.4498,49.801,50.367,50.933,51.499,51.8879,52.2652,52.4452,52.8341,53.5975,54.1547,54.7439,54.9384,55.1271,55.696,56.0849,56.4593,56.8366,57.2169,57.6145,58.3692,59.5127,60.6476,62.1917,62.5633,67.1666,67.335,67.5265,67.9155,68.2928,68.6701,70.0604,70.1649,70.3536,70.5596,70.9341,72.0805,72.2576,72.4579,73.018,73.2125,73.4012,74.3445,74.7305,74.9105")
crash_accents_seconds = Panel("42.687,47.5312,49.8039,50.9446,54.1605,55.13")
parse_hit_times = PARSEHITTIMES(
    snare_csv=snare_seconds,
    hat_csv=cymbal_seconds,
    kick_csv=kick_seconds,
    pedal_csv=hat_pedal_chart_groove,
    heavy_csv=snare_accents_seconds,
    crash_csv=crash_accents_seconds)  # -> snare, hat, kick, pedal, event_data
# ---------- parse_hit_times: Python ----------
import json
def parse(s):return sorted(set(float(v.strip()) for v in str(s).split(',') if v.strip()))
snare=parse(snare_csv);hat=parse(hat_csv);kick=parse(kick_csv);pedal=parse(pedal_csv)
event_data=json.dumps(dict(heavy=parse(heavy_csv),crash=parse(crash_csv),pedal=pedal,velocities=[],midi=False))
# ---------- end parse_hit_times ----------
seconds_frame = SECONDSFRAME(playback=playback_0_to_1, duration=clip_length_seconds)  # -> seconds, frame
# ---------- seconds_frame: Python ----------
seconds = max(0.0, min(1.0, float(playback))) * float(duration)
frame = int(seconds * 24)
# ---------- end seconds_frame ----------
stick_geometry = STICKGEOMETRY(length=stick_mm)  # -> mesh, tcp
# ---------- stick_geometry: Python ----------
from Rhino.Geometry import Mesh, Cylinder, Circle, Plane, Sphere, Point3d, Vector3d, Box, Interval, Transform, MeshingParameters, PolylineCurve, RevSurface, Line
length=float(length);radius=7 if length>150 else 20
mesh=Mesh.CreateFromCylinder(Cylinder(Circle(Plane.WorldXY,radius),length),1,16)
mesh.Append(Mesh.CreateFromSphere(Sphere(Point3d(0,0,length),8 if length>150 else 24),12,8))
tcp=Plane(Point3d(0,0,length),Vector3d.ZAxis)
# ---------- end stick_geometry ----------
presser_geometry = PRESSERGEOMETRY(length=presser_mm)  # -> mesh, tcp; same code as stick_geometry
rim_crash_hat_state = RIMCRASHHATSTATE(seconds=seconds_frame.seconds, event_data=parse_hit_times.event_data)  # -> articulation
# ---------- rim_crash_hat_state: Python ----------
import json, math
state = json.loads(str(event_data))
def near(values):return min([abs(float(seconds)-v) for v in values]+[100.0])
def ease(v):
 v=max(0.0,min(1.0,v));return v*v*(3-2*v)
rim = ease((near(state['heavy'])-.16)/.24)
crash = ease((.42-near(state['crash']))/.26)
hits=state.get('velocities',[])
history=[v for v in hits if v['time']<=seconds and (v['role']=='pedal' or v['note'] in [42,46])]
opened=bool(history and max(history,key=lambda v:v['time'])['note']==46)
strengths=[]
for roles in [['snare','rim'],['hat','crash'],['kick'],['pedal']]:
 selected=[v for v in hits if v['role'] in roles]
 velocity=min(selected,key=lambda v:abs(seconds-v['time']))['velocity'] if selected else 64
 strengths.append(.45+.55*velocity/127.0 if state['midi'] else 1.0)
opening=4.0 if opened else 0.0
if not state['midi']:
 opening=4*(.5-.5*math.cos(math.pi*min(1.0,near(state['pedal'])/.16)))
articulation=json.dumps(dict(rim=rim,crash=crash,opening=opening,opened=opened,strengths=strengths,midi=state['midi']))
# ---------- end rim_crash_hat_state ----------
# HOW TO READ: Purple: event timing / Blue: target geometry / Green: native Robots components
# Scrub PLAYBACK. Double-click a Python node to inspect its small, single-purpose operation.
# Meshes, event data and code are embedded. Camera, fireworks and audio remain in the render script.
stick_tool = CreateTool(Name="Stick", TCP=stick_geometry.tcp, Weight=0.15, Mesh=stick_geometry.mesh)  # -> Tool, TCP
presser_tool = CreateTool(Name="PedalPress", TCP=presser_geometry.tcp, Weight=0.15, Mesh=presser_geometry.mesh)  # -> Tool, TCP
robot_model = Panel("UR10e")
target_motion = Panel("Linear")
output_robot_meshes = BooleanToggle(True)

# ---- group: 1 / SNARE
snare_arm_index = Panel("0")
snare_rebound = SNAREREBOUND(seconds=seconds_frame.seconds, events=parse_hit_times.snare, articulation=rim_crash_hat_state, arm_index=snare_arm_index)  # -> rebound, lift, phase; inputs events: list
# ---------- snare_rebound: Python ----------
import math,json
state=json.loads(str(articulation));index=int(arm_index)
hits=[float(v.Value if hasattr(v,'Value') else v) for v in events]
distance=min([abs(float(seconds)-v) for v in hits]+[1.0])
phase=min(1.0,distance/(.115 if index<2 else .16))
rebound=.5-.5*math.cos(math.pi*phase)
strength=state['strengths'][index]
lift=(48.0 if index<2 else 8.0 if index==3 else 28.0)*rebound*strength
if index==3 and state['midi']:lift=8.0 if state['opened'] else 0.0
# ---------- end snare_rebound ----------
snare_target_plane = SNARETARGETPLANE(
    rebound=snare_rebound.rebound,
    lift=snare_rebound.lift,
    articulation=rim_crash_hat_state,
    arm_index=snare_arm_index,
    length=stick_mm)  # -> plane, contact
# ---------- snare_target_plane: Python ----------
import math,json
from Rhino.Geometry import Point3d,Vector3d,Plane
state=json.loads(str(articulation));index=int(arm_index)
rim=state['rim'];crash=state['crash']
points=[Point3d(-350,-100+180*rim,668),Point3d(660+160*crash,-50+380*crash,968+115*crash+state['opening']),Point3d(0,-460,92),Point3d(550,-380,92)]
contact=points[index]
if index<2:
 angle=.72+(.76*rim if index==0 else 0)
 swing=((.36-.29*rim) if index==0 else .24)*float(rebound)*state['strengths'][index]
 direction=Vector3d(0,math.sin(angle+swing),-math.cos(angle+swing))
 wrist=contact-Vector3d(0,math.sin(angle),-math.cos(angle))*float(length)
 plane=Plane(wrist+direction*float(length),Vector3d.XAxis,Vector3d.CrossProduct(direction,Vector3d.XAxis))
else:plane=Plane(contact+Vector3d(0,0,float(lift)),Vector3d.XAxis,-Vector3d.YAxis)
# ---------- end snare_target_plane ----------
snare_mount = Plane(PlaneXY(-1050, -200, 200))
load_snare_ur10e = LoadRobotSystem(Name=robot_model, Base=snare_mount)
snare_target = CreateTarget(Plane=snare_target_plane.plane, Motion=target_motion, Tool=stick_tool.Tool, IsCartesian=True)
snare_ik = Kinematics(RobotSystem=load_snare_ur10e, Target=snare_target, DisplayGeometry=output_robot_meshes)  # -> Meshes, Joints, Planes, Errors
snare_joints_radians = Panel(snare_ik.Joints)
snare_ik_errors = Panel(snare_ik.Errors)

# ---- group: 2 / HI-HAT
hi_hat_arm_index = Panel("1")
hi_hat_rebound = HIHATREBOUND(seconds=seconds_frame.seconds, events=parse_hit_times.hat, articulation=rim_crash_hat_state, arm_index=hi_hat_arm_index)  # -> rebound, lift, phase; inputs events: list; same code as snare_rebound
hi_hat_target_plane = HIHATTARGETPLANE(
    rebound=hi_hat_rebound.rebound,
    lift=hi_hat_rebound.lift,
    articulation=rim_crash_hat_state,
    arm_index=hi_hat_arm_index,
    length=stick_mm)  # -> plane, contact; same code as snare_target_plane
hi_hat_mount = Plane(PlaneXY(1150, 0, 350))
load_hi_hat_ur10e = LoadRobotSystem(Name=robot_model, Base=hi_hat_mount)
hi_hat_target = CreateTarget(Plane=hi_hat_target_plane.plane, Motion=target_motion, Tool=stick_tool.Tool, IsCartesian=True)
hi_hat_ik = Kinematics(RobotSystem=load_hi_hat_ur10e, Target=hi_hat_target, DisplayGeometry=output_robot_meshes)  # -> Meshes, Joints, Planes, Errors
hi_hat_joints_radians = Panel(hi_hat_ik.Joints)
hi_hat_ik_errors = Panel(hi_hat_ik.Errors)

# ---- group: 3 / KICK
kick_arm_index = Panel("2")
kick_rebound = KICKREBOUND(seconds=seconds_frame.seconds, events=parse_hit_times.kick, articulation=rim_crash_hat_state, arm_index=kick_arm_index)  # -> rebound, lift, phase; inputs events: list; same code as snare_rebound
kick_target_plane = KICKTARGETPLANE(
    rebound=kick_rebound.rebound,
    lift=kick_rebound.lift,
    articulation=rim_crash_hat_state,
    arm_index=kick_arm_index,
    length=presser_mm)  # -> plane, contact; same code as snare_target_plane
kick_mount = Plane(PlaneXY(-700, -1050, 0))
load_kick_ur10e = LoadRobotSystem(Name=robot_model, Base=kick_mount)
kick_target = CreateTarget(Plane=kick_target_plane.plane, Motion=target_motion, Tool=presser_tool.Tool, IsCartesian=True)
kick_ik = Kinematics(RobotSystem=load_kick_ur10e, Target=kick_target, DisplayGeometry=output_robot_meshes)  # -> Meshes, Joints, Planes, Errors
kick_joints_radians = Panel(kick_ik.Joints)
kick_ik_errors = Panel(kick_ik.Errors)

# ---- group: 4 / HAT PEDAL
hat_pedal_arm_index = Panel("3")
hat_pedal_rebound = HATPEDALREBOUND(
    seconds=seconds_frame.seconds,
    events=parse_hit_times.pedal,
    articulation=rim_crash_hat_state,
    arm_index=hat_pedal_arm_index)  # -> rebound, lift, phase; inputs events: list; same code as snare_rebound
hat_pedal_target_plane = HATPEDALTARGETPLANE(
    rebound=hat_pedal_rebound.rebound,
    lift=hat_pedal_rebound.lift,
    articulation=rim_crash_hat_state,
    arm_index=hat_pedal_arm_index,
    length=presser_mm)  # -> plane, contact; same code as snare_target_plane
hat_pedal_mount = Plane(PlaneXY(1150, -850, 0))
load_hat_pedal_ur10e = LoadRobotSystem(Name=robot_model, Base=hat_pedal_mount)
hat_pedal_target = CreateTarget(Plane=hat_pedal_target_plane.plane, Motion=target_motion, Tool=presser_tool.Tool, IsCartesian=True)
hat_pedal_ik = Kinematics(RobotSystem=load_hat_pedal_ur10e, Target=hat_pedal_target, DisplayGeometry=output_robot_meshes)  # -> Meshes, Joints, Planes, Errors
hat_pedal_joints_radians = Panel(hat_pedal_ik.Joints)
hat_pedal_ik_errors = Panel(hat_pedal_ik.Errors)

# ----
pedal_linkages_top_cymbal = PEDALLINKAGESTOPCYMBAL(kick_lift=kick_rebound.lift, hat_lift=hat_pedal_rebound.lift)  # -> meshes
# ---------- pedal_linkages_top_cymbal: Python ----------
import math
from Rhino.Geometry import Mesh, Cylinder, Circle, Plane, Sphere, Point3d, Vector3d, Box, Interval, Transform, MeshingParameters, PolylineCurve, RevSurface, Line
from System.Drawing import Color
meshes=[]
contacts=[0,0,float(kick_lift),float(hat_lift)]
# Pedal mechanisms are driven by the same contact heights as their arms.
def append_brep(b,color):
    for m in Mesh.CreateFromBrep(b,MeshingParameters.FastRenderMesh):
        m.VertexColors.CreateMonotoneMesh(color);meshes.append(m)
for x,y,lift in [(0,-460,contacts[2]),(550,-380,contacts[3])]:
    b=Box(Plane.WorldXY,Interval(x-46,x+46),Interval(y-100,y+100),Interval(50,68)).ToBrep()
    # Match the presser's center height while rotating about the rear hinge.
    angle=math.atan2(lift,100.0)
    b.Transform(Transform.Rotation(angle,Vector3d.XAxis,Point3d(x,y-100,59)))
    append_brep(b,Color.FromArgb(175,190,199))
# Kick linkage: the beater swings toward the drum as the pedal descends.
end=Point3d(0,-230-contacts[2]*2.1,285)
start=Point3d(0,-350,55);direction=end-start
append_brep(Cylinder(Circle(Plane(start,direction),9),direction.Length).ToBrep(True,True),Color.FromArgb(180,195,205))
append_brep(Sphere(end,32).ToBrep(),Color.FromArgb(224,219,200))
# Hi-hat top plate opens 0..14 mm as its pedal arm releases.
z=957+contacts[3]*.5
profile=PolylineCurve([Point3d(550+r,-50,z+h) for r,h in [(0,27),(35,30),(62,11),(180,0),(180,-3),(62,6),(35,24),(0,22)]])
append_brep(RevSurface.Create(profile,Line(Point3d(550,-50,z-50),Point3d(550,-50,z+60)),0,2*math.pi).ToBrep(),Color.FromArgb(185,131,48))
# ---------- end pedal_linkages_top_cymbal ----------
# PREVIEW: OUTPUT
# 32 posed robot/tool meshes + 17 mechanism meshes
# Joint angles and IK errors are visible for each arm.
# Native Robots nodes solve poses; no hardware is connected.
internal_stage_geometry = Geometry([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])
animated_robots = Geometry([snare_ik.Meshes, hi_hat_ik.Meshes, kick_ik.Meshes, hat_pedal_ik.Meshes, pedal_linkages_top_cymbal])
