# Grasshopper definition Birdland-Robots.gh (Grasshopper 1.0.8)
# plug-ins: Robots

# ---- group: 01 / AUDIO CLOCK + PLAYBACK
# BIRDLAND / WEATHER REPORT
# Original recording: opening 75 seconds
# Four robot arms / 24 fps
# Drag PLAYBACK to scrub 0..75 seconds.
# Clip length is adjustable from 5 to 75 seconds.
# Event panels contain seconds from the audio start.
# Timing follows audio onsets; form and articulation follow the chart.
# Light rim clicks + opening hats in intro; larger strokes on shots.
clip_length_seconds = Slider(75, range=5..75)
playback_0_to_1 = Slider(0.3, range=0..1)

# ---- group: 02 / EDIT THE GROOVE
snare_seconds = Panel("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")
cymbal_seconds = Panel("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")
kick_seconds = Panel("18.5254,21.4581,31.6430,32.2815,36.9197,42.6870,42.9743,43.0643,44.4778,46.0016,47.5312,48.6835,49.0551,49.4527,49.8039,50.9446,52.4481,52.8370,53.6033,54.1605,55.1300,67.3408,69.7034,70.0662,70.3652,72.2663,73.0268,73.4070,74.9134")
hat_pedal_chart_groove = Panel("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")

# ---- group: 03 / FOUR UR10e SYSTEMS
# READ ME
# Actual stereo audio is embedded in Birdland-Robots.mp4.
# Source: Weather Report official artist channel, video SvhmaNlLgRM.
# The GH file contains all event times, code and stage geometry.
# Robots 2.4.0 + UniversalRobot library required.
# Kinematic visualization; collisions and robot dynamics are not certified.
snare_arm = LoadRobotSystem(Name="UR10e", Base=PlaneXY(-1050, -200, 200))
hat_arm = LoadRobotSystem(Name="UR10e", Base=PlaneXY(1150, 0, 350))
kick_arm = LoadRobotSystem(Name="UR10e", Base=PlaneXY(-700, -1050, 0))
pedal_arm = LoadRobotSystem(Name="UR10e", Base=PlaneXY(1150, -850, 0))

# ---- group: 04 / SOLVE + PREVIEW
birdland_audio_clock = BeatClockRobotsIK(
    t=playback_0_to_1,
    bpm=clip_length_seconds,
    r0=snare_arm,
    r1=hat_arm,
    r2=kick_arm,
    r3=pedal_arm,
    snare=snare_seconds,
    hat=cymbal_seconds,
    kick=kick_seconds,
    pedal=hat_pedal_chart_groove)  # -> meshes, paths, errors, contacts, status
# ---------- birdland_audio_clock: Python ----------
# Embedded in the GH file. No external data files are read.
import clr, System, math
import Rhino
from Rhino.Geometry import *
from System.Drawing import Color
for assembly in System.AppDomain.CurrentDomain.GetAssemblies():
    if assembly.GetName().Name == 'Robots': clr.AddReference(assembly)
import Robots

def unbox(v):
    return v.Value if hasattr(v,'Value') else v

def pattern(value):
    return sorted(set(float(v.strip()) for v in str(value).replace(';',',').split(',') if v.strip()))

duration = float(bpm)
seconds = max(0.0,min(1.0,float(t))) * duration
beat = seconds
patterns = [pattern(snare),pattern(hat),pattern(kick),pattern(pedal)]
robots = [unbox(r0),unbox(r1),unbox(r2),unbox(r3)]
points = [Point3d(-350,-100,668),Point3d(660,-50,968),Point3d(0,-460,92),Point3d(550,-380,92)]

heavyTimes = [42.228400000000001, 42.506999999999998, 42.684100000000001, 42.974299999999999, 44.472000000000001, 45.444400000000002, 45.998699999999999, 47.348399999999998, 48.483300000000000, 48.677700000000002, 49.049300000000002, 49.449800000000003, 49.801000000000002, 50.366999999999997, 50.933000000000000, 51.499000000000002, 51.887900000000002, 52.265200000000000, 52.445200000000000, 52.834099999999999, 53.597499999999997, 54.154699999999998, 54.743899999999996, 54.938400000000001, 55.127099999999999, 55.695999999999998, 56.084899999999998, 56.459299999999999, 56.836599999999997, 57.216900000000003, 57.614500000000000, 58.369199999999999, 59.512700000000002, 60.647599999999997, 62.191699999999997, 62.563299999999998, 67.166600000000003, 67.334999999999994, 67.526499999999999, 67.915499999999994, 68.292800000000000, 68.670100000000005, 70.060400000000001, 70.164900000000003, 70.353600000000000, 70.559600000000003, 70.934100000000001, 72.080500000000001, 72.257599999999996, 72.457899999999995, 73.018000000000001, 73.212500000000006, 73.401200000000003, 74.344499999999996, 74.730500000000006, 74.910499999999999]
crashTimes = [42.686999999999998, 47.531199999999998, 49.803899999999999, 50.944600000000001, 54.160499999999999, 55.130000000000003]
def nearestTime(times):
    return min([abs(seconds-v) for v in times]+[100.0])
def ease(v):
    v=max(0.0,min(1.0,v));return v*v*(3-2*v)
rimWeight=ease((nearestTime(heavyTimes)-.16)/.24)
points[0]=Point3d(-350,-100+180*rimWeight,668)
crashWeight=ease((.42-nearestTime(crashTimes))/.26)
points[1]=Point3d(660+160*crashWeight,-50+380*crashWeight,968+115*crashWeight)

pedalDistance=min([abs(beat-v) for v in patterns[3]]+[1.0])
points[1].Z += 4.0*(0.5-0.5*math.cos(math.pi*min(1.0,pedalDistance/.16)))
meshes=[]; paths=[]; errors=[]; contacts=[]
for i,robot in enumerate(robots):
    events = [v for v in patterns[i]]
    # At contact: z=0. Between contacts: smooth half-cosine rebound.
    distance = min([abs(beat-v) for v in events]+[1.0])
    phase = min(1.0,distance / (0.115 if i<2 else 0.16))
    lift = (48.0 if i<2 else 8.0 if i==3 else 28.0) * (0.5-0.5*math.cos(math.pi*phase))
    p = points[i] + Vector3d(0,0,lift)
    length = 300.0 if i<2 else 100.0
    toolMesh=Mesh.CreateFromCylinder(Cylinder(Circle(Plane.WorldXY,7 if i<2 else 20),length),1,16)
    cap=Mesh.CreateFromSphere(Sphere(Point3d(0,0,length),8 if i<2 else 24),12,8)
    toolMesh.Append(cap)
    tool=Robots.Tool(Plane(Point3d(0,0,length),Vector3d.ZAxis),'Stick' if i<2 else 'PedalPress',0.15,None,toolMesh)
    if i<2:
        # Hold a virtual wrist pivot; rotate the stick through an arc.
        # Contact is 41 degrees from vertical, rebound is 61 degrees.
        strikeAngle=0.72+(0.76*rimWeight if i==0 else 0.0)
        swing=((0.36-0.29*rimWeight) if i==0 else 0.24)*(0.5-0.5*math.cos(math.pi*phase))
        direction=Vector3d(0,math.sin(strikeAngle+swing),-math.cos(strikeAngle+swing))
        contactDirection=Vector3d(0,math.sin(strikeAngle),-math.cos(strikeAngle))
        wrist=points[i]-contactDirection*length
        p=wrist+direction*length
        targetPlane=Plane(p,Vector3d.XAxis,Vector3d.CrossProduct(direction,Vector3d.XAxis))
    else:
        targetPlane=Plane(p,Vector3d.XAxis,-Vector3d.YAxis)
    target=Robots.CartesianTarget(targetPlane,None,Robots.Motions.Linear,tool)
    solutions=robot.Kinematics(System.Array[Robots.Target]([target]))
    poser=Robots.RhinoMeshPoser(robot)
    poser.Pose(solutions,System.Array[Robots.Tool]([tool]))
    colors=[Color.FromArgb(32,45,54),Color.FromArgb(26,139,150),Color.FromArgb(180,198,208),Color.FromArgb(180,198,208),Color.FromArgb(26,139,150),Color.FromArgb(26,139,150),Color.FromArgb(90,112,121),Color.FromArgb(240,166,80)]
    for j,m in enumerate(poser.Meshes):
        if m is not None:
            m.VertexColors.CreateMonotoneMesh(colors[min(j,7)])
            meshes.append(m)
    errors.extend(['Arm '+str(i+1)+': '+str(e) for e in solutions[0].Errors])
    contacts.append(lift)
    paths.append(LineCurve(points[i],points[i]+Vector3d(0,0,48 if i<2 else 28)))
status = 'BIRDLAND / ORIGINAL AUDIO\nTime {0:.2f} / {1:.2f} s\nFrame {2} at 24 fps\nIK errors: {3}\nAudio-derived onsets; approximate instrument mapping.'.format(seconds,duration,int(seconds*24),len(errors))

# Pedal mechanisms are driven by the same contact heights as their arms.
def append_brep(b,color):
    for m in Mesh.CreateFromBrep(b,MeshingParameters.FastRenderMesh):
        m.VertexColors.CreateMonotoneMesh(color);meshes.append(m)
for x,y,lift in [(0,-460,contacts[2]),(550,-380,contacts[3])]:
    b=Box(Plane.WorldXY,Interval(x-46,x+46),Interval(y-100,y+100),Interval(50,68)).ToBrep()
    # Match the presser's center height while rotating about the rear hinge.
    angle=math.atan2(lift,100.0)
    b.Transform(Transform.Rotation(angle,Vector3d.XAxis,Point3d(x,y-100,59)))
    append_brep(b,Color.FromArgb(175,190,199))
# Kick linkage: the beater swings toward the drum as the pedal descends.
end=Point3d(0,-230-contacts[2]*2.1,285)
start=Point3d(0,-350,55);direction=end-start
append_brep(Cylinder(Circle(Plane(start,direction),9),direction.Length).ToBrep(True,True),Color.FromArgb(180,195,205))
append_brep(Sphere(end,32).ToBrep(),Color.FromArgb(224,219,200))
# Hi-hat top plate opens 0..14 mm as its pedal arm releases.
z=957+contacts[3]*.5
profile=PolylineCurve([Point3d(550+r,-50,z+h) for r,h in [(0,27),(35,30),(62,11),(180,0),(180,-3),(62,6),(35,24),(0,22)]])
append_brep(RevSurface.Create(profile,Line(Point3d(550,-50,z-50),Point3d(550,-50,z+60)),0,2*math.pi).ToBrep(),Color.FromArgb(185,131,48))
# ---------- end birdland_audio_clock ----------
internal_stage_geometry = Geometry([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])
animated_robots = Geometry(birdland_audio_clock.meshes)
panel = Panel(birdland_audio_clock.status)
