# Grasshopper definition MIDI-Drum-Robots.gh (Grasshopper 1.0.8)
# plug-ins: Robots

# ---- group: 00 / MIDI FILE -> EMBEDDED EVENTS
# MIDI QUICK START: IMPORT A DRUM MIDI
# Paste an absolute .mid path into FILE TO IMPORT.
# Valid imports replace EMBEDDED BYTES and clear the path.
# Save this GH definition after importing.
# The supplied demo is already embedded.
# Drag PLAYBACK to scrub; the clip duration follows the MIDI.
# GH does not synthesize audio.
midi_file_to_import = Panel("")
editable_gm_note_map = Panel("""kick=35,36
snare=38,40
rim=37
hat=42,46
pedal=44
crash=49,51,52,53,55,57,59
tom=41,43,45,47,48,50""")
tom_policy_snare_or_ignore = Panel("snare")
midi_embedded_bytes = Panel("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")
channel_0_auto_1_all = Slider(0, range=-1..16)
start_offset_seconds = Slider(0, range=0..300)
playback_speed = Slider(1, range=0.25..3)
midi_import_internalize = StandardMIDIFileToRobotEventClock(
    file_path=midi_file_to_import,
    embedded=midi_embedded_bytes,
    channel=channel_0_auto_1_all,
    note_map=editable_gm_note_map,
    start_seconds=start_offset_seconds,
    speed=playback_speed,
    tom_policy=tom_policy_snare_or_ignore)  # -> result_json, duration, snare_times, hat_times, kick_times, pedal_times, report
# ---------- midi_import_internalize: Python ----------
"""Dependency-free Standard MIDI File parser, compatible with Rhino GhPython (2.7).
SMF 0/1, PPQN tempo maps and SMPTE division. No MIDI playback or hardware I/O.
"""
import struct,bisect,base64
DEFAULT_MAPPING = {'kick':[35,36], 'snare':[38,40], 'rim':[37], 'hat':[42,46],
                   'pedal':[44], 'crash':[49,51,52,53,55,57,59], 'tom':[41,43,45,47,48,50]}

def _byte(data,i):
    v=data[i]
    return v if isinstance(v,int) else ord(v)

def _vlq(data,pos,end):
    value=0
    for unused in range(4):
        if pos>=end:raise ValueError('Truncated variable-length MIDI number')
        b=_byte(data,pos);pos+=1;value=(value<<7)|(b&127)
        if b<128:return value,pos
    raise ValueError('MIDI variable-length number exceeds four bytes')

def parse_mapping(text):
    result=dict((k,list(v)) for k,v in DEFAULT_MAPPING.items())
    if text and str(text).strip():
        for line in str(text).splitlines():
            line=line.split('#',1)[0].strip()
            if not line:continue
            if '=' not in line:raise ValueError('Mapping lines must be role=note,note')
            role,notes=line.split('=',1);role=role.strip().lower()
            if role not in result:raise ValueError('Unknown role: '+role)
            result[role]=[int(n.strip()) for n in notes.split(',') if n.strip()]
    seen={}
    for role,notes in result.items():
        for note in notes:
            if not 0<=note<=127:raise ValueError('MIDI notes must be 0..127')
            if note in seen:raise ValueError('Note %s appears in both %s and %s'%(note,seen[note],role))
            seen[note]=role
    return result

def parse_midi(data,channel=0,mapping=None,start=0.0,speed=1.0,tom_policy='snare'):
    # channel: 0 auto (channel 10 preferred), 1..16 explicit, -1 all.
    if not data or data[:4]!=b'MThd':raise ValueError('Expected a Standard MIDI .mid/.midi file (MThd header)')
    if len(data)<14:raise ValueError('Truncated MIDI header')
    size=struct.unpack('>I',data[4:8])[0]
    if size<6 or 8+size>len(data):raise ValueError('Invalid MIDI header length')
    fmt,ntracks,division=struct.unpack('>HHH',data[8:14])
    if fmt not in (0,1):raise ValueError('MIDI type 2 contains independent songs; export as type 0 or 1 first')
    if not ntracks or (fmt==0 and ntracks!=1):raise ValueError('Invalid MIDI track count')
    if not division:raise ValueError('MIDI time division cannot be zero')
    speed=float(speed);start=float(start);channel=int(channel)
    if speed<=0 or start<0:raise ValueError('Speed must be positive and start must be non-negative')
    if channel not in range(-1,17):raise ValueError('Channel must be -1 (all), 0 (auto), or 1..16')
    mapping=mapping or DEFAULT_MAPPING
    lookup=dict((n,k) for k,notes in mapping.items() for n in notes)
    pos=8+size;notes=[];tempos=[(0,-1,500000)];end_tick=0;order=0
    for track in range(ntracks):
        if pos+8>len(data) or data[pos:pos+4]!=b'MTrk':raise ValueError('Missing MIDI track %s'%track)
        length=struct.unpack('>I',data[pos+4:pos+8])[0];pos+=8;end=pos+length
        if end>len(data):raise ValueError('Truncated MIDI track %s'%track)
        tick=0;running=None
        while pos<end:
            delta,pos=_vlq(data,pos,end);tick+=delta;end_tick=max(end_tick,tick)
            if pos>=end:raise ValueError('Missing MIDI event status')
            b=_byte(data,pos)
            if b>=128:status=b;pos+=1
            elif running is not None:status=running
            else:raise ValueError('Running status without a preceding channel message')
            if status==255:
                running=None
                if pos>=end:raise ValueError('Truncated meta event')
                kind=_byte(data,pos);pos+=1;length,pos=_vlq(data,pos,end)
                if pos+length>end:raise ValueError('Truncated meta payload')
                if kind==81:
                    if length!=3:raise ValueError('Tempo meta event must have three bytes')
                    tempo=(_byte(data,pos)<<16)|(_byte(data,pos+1)<<8)|_byte(data,pos+2)
                    if tempo<=0:raise ValueError('MIDI tempo must be positive')
                    tempos.append((tick,order,tempo));order+=1
                pos+=length
                if kind==47:break
            elif status in (240,247):
                running=None;length,pos=_vlq(data,pos,end)
                if pos+length>end:raise ValueError('Truncated system-exclusive payload')
                pos+=length
            elif 128<=status<=239:
                running=status;kind=status&240;ch=status&15;count=1 if kind in (192,208) else 2
                if pos+count>end:raise ValueError('Truncated channel event')
                values=[_byte(data,pos+i) for i in range(count)];pos+=count
                if any(v>=128 for v in values):raise ValueError('Invalid MIDI data byte')
                if kind==144 and values[1]>0:notes.append((tick,track,ch,values[0],values[1]))
            else:raise ValueError('Unsupported status byte in Standard MIDI file: %s'%status)
        pos=end
    warnings=[];tempos.sort();tempo_ticks=[];tempo_seconds=[];tempo_values=[]
    if division&32768:
        code=(division>>8)-256;tpf=division&255
        if code not in (-24,-25,-29,-30) or not tpf:raise ValueError('Unsupported SMPTE time division')
        fps=29.97 if code==-29 else float(-code)
        def seconds(tick):return tick/(fps*tpf)
        warnings.append('SMPTE timing: tempo messages do not affect event seconds.')
    else:
        last_tick=0;elapsed=0.0;tempo=500000
        for tick,unused,newtempo in tempos:
            elapsed+=(tick-last_tick)*tempo/(division*1000000.0)
            if tempo_ticks and tick==tempo_ticks[-1]:tempo_values[-1]=newtempo
            else:tempo_ticks.append(tick);tempo_seconds.append(elapsed);tempo_values.append(newtempo)
            tempo=newtempo;last_tick=tick
        def seconds(tick):
            i=bisect.bisect_right(tempo_ticks,tick)-1
            return tempo_seconds[i]+(tick-tempo_ticks[i])*tempo_values[i]/(division*1000000.0)
    present=sorted(set(n[2] for n in notes));mapped_channels=sorted(set(n[2] for n in notes if n[3] in lookup))
    if channel==0:
        if 9 in present:selected=[9]
        elif len(mapped_channels)==1:selected=mapped_channels;warnings.append('No channel 10: using the sole mapped-note channel %s.'%(selected[0]+1))
        elif not mapped_channels:raise ValueError('No mapped drum notes found')
        else:raise ValueError('Several non-GM channels contain mapped notes. Choose the drum channel (1..16), or -1 for all.')
    else:selected=present if channel==-1 else [channel-1]
    events=dict((k,[]) for k in ['kick','snare','rim','hat','pedal','heavy','crash','open_hat','tom'])
    velocities=[];ignored={};tom_count=0
    for tick,track,ch,note,velocity in notes:
        if ch not in selected:continue
        absolute=seconds(tick)
        if absolute<start:continue
        when=(absolute-start)/speed;role=lookup.get(note)
        if not role:ignored[note]=ignored.get(note,0)+1;continue
        if role=='tom':
            tom_count+=1;events['tom'].append(when)
            if tom_policy=='ignore':continue
            if tom_policy!='snare':raise ValueError('Tom policy must be snare or ignore')
            role='snare'
        velocities.append({'time':when,'note':note,'velocity':velocity,'role':role,'channel':ch+1,'track':track})
        events[role].append(when)
        if role=='rim':events['snare'].append(when)
        if role=='snare':events['heavy'].append(when)
        if role=='crash':events['hat'].append(when)
        if role=='hat' and note==46:events['open_hat'].append(when)
    for key in events:events[key]=sorted(set(round(x,6) for x in events[key]))
    if not velocities:raise ValueError('No mapped drum hits remain for the selected channel/start')
    if ignored:warnings.append('Unmapped note numbers skipped: '+', '.join('%s (%s)'%(k,ignored[k]) for k in sorted(ignored)))
    if tom_count:warnings.append('%s tom hits %s; this four-arm scene has no independent tom choreography.'%(tom_count,'routed to snare' if tom_policy=='snare' else 'ignored'))
    duration=max((seconds(end_tick)-start)/speed,max(x['time'] for x in velocities)+.5)
    return {'events':events,'velocities':velocities,'duration':duration,'channels':[v+1 for v in selected],
            'format':fmt,'tracks':ntracks,'warnings':warnings,'tempo_changes':len(tempos)-1,
            'note_count':len(velocities),'source':'Standard MIDI file','mapping':mapping}

# Appended to midi_adapter.py inside the GhPython component.
import json,os,Grasshopper as GH
from System import Guid
result_json=None;duration=0.0;snare_times='';hat_times='';kick_times='';pedal_times='';report=''
try:
    requested=str(file_path or '').strip().strip('"')
    raw=open(requested,'rb').read() if requested else base64.b64decode(str(embedded or '').strip())
    result=parse_midi(raw,channel=int(channel),mapping=parse_mapping(note_map),start=float(start_seconds),speed=float(speed),tom_policy=str(tom_policy or 'snare').strip())
    result_json=json.dumps(result);duration=result['duration']
    def csv(name):return ','.join('{:.6f}'.format(v) for v in result['events'][name])
    snare_times=csv('snare');hat_times=csv('hat');kick_times=csv('kick');pedal_times=csv('pedal')
    report='MIDI: {0} hits / {1:.3f} seconds\nChannels: {2}; tempo changes: {3}\n'.format(result['note_count'],duration,result['channels'],result['tempo_changes'])+'\n'.join(result['warnings'])
    report+='\nVelocities scale stroke heights; MIDI itself produces no audio.'
    if requested:
        encoded=base64.b64encode(raw)
        if not isinstance(encoded,str):encoded=encoded.decode('ascii')
        document=ghenv.Component.OnPingDocument()
        cache=next(o for o in document.Objects if o.NickName=='MIDI / EMBEDDED BYTES')
        filepath=next(o for o in document.Objects if o.NickName=='MIDI / FILE TO IMPORT')
        def cache_import(doc):
            cache.UserText=encoded;cache.ExpireSolution(False)
            filepath.UserText='';filepath.ExpireSolution(False)
        document.ScheduleSolution(1,GH.Kernel.GH_Document.GH_ScheduleDelegate(cache_import))
        report+='\nImported bytes are being embedded. Save the GH file to retain them.'
    else:report+='\nUsing embedded MIDI bytes: no external MIDI file needed.'
except Exception as error:
    report='MIDI IMPORT ERROR: '+str(error)
    ghenv.Component.AddRuntimeMessage(GH.Kernel.GH_RuntimeMessageLevel.Error,str(error))
# ---------- end midi_import_internalize ----------
midi_import_status = Panel(midi_import_internalize.report)

# ---- group: 01 / AUDIO CLOCK + PLAYBACK
# MIDI / FOUR ROBOT ARMS
# Standard MIDI drum adapter
# Two sticks + kick + hi-hat pedal
# Drag PLAYBACK to scrub the imported MIDI duration.
# The MIDI import status reports missing mappings and approximations.
# Velocity scales rebound height. Hi-hat open/closed notes drive the pedal.
# No external MIDI file is needed after import and Save.
legacy_clip_length_not_used = Slider(75, range=5..75)
playback_0_to_1 = Slider(0.2, range=0..1)

# ---- group: 02 / EDIT THE GROOVE
midi_snare = Panel(midi_import_internalize.snare_times)
midi_cymbals = Panel(midi_import_internalize.hat_times)
midi_kick = Panel(midi_import_internalize.kick_times)
midi_pedal = Panel(midi_import_internalize.pedal_times)

# ---- group: 03 / FOUR UR10e SYSTEMS
# READ ME
# Requires Rhino 8 + GhPython + Robots 2.4.0 + UniversalRobot library.
# MIDI parser, imported bytes, event data, geometry and solver are internal.
# Custom drum note maps are editable. Type 0/1 MIDI supported.
# Tom routing is approximate; unmapped notes are reported.
# No controller connection. Kinematics only; dynamics/collisions unverified.
snare_arm = LoadRobotSystem(Name="UR10e", Base=PlaneXY(-1050, -200, 200))
hat_arm = LoadRobotSystem(Name="UR10e", Base=PlaneXY(1150, 0, 350))
kick_arm = LoadRobotSystem(Name="UR10e", Base=PlaneXY(-700, -1050, 0))
pedal_arm = LoadRobotSystem(Name="UR10e", Base=PlaneXY(1150, -850, 0))

# ---- group: 04 / SOLVE + PREVIEW
midi_four_arm_solver = BeatClockRobotsIK(
    t=playback_0_to_1,
    bpm=midi_import_internalize.duration,
    r0=snare_arm,
    r1=hat_arm,
    r2=kick_arm,
    r3=pedal_arm,
    snare=midi_snare,
    hat=midi_cymbals,
    kick=midi_kick,
    pedal=midi_pedal,
    midijson=midi_import_internalize.result_json)  # -> meshes, paths, errors, contacts, status
# ---------- midi_four_arm_solver: Python ----------
# Embedded in the GH file. No external data files are read.
import clr, System, math
import Rhino
from Rhino.Geometry import *
from System.Drawing import Color
for assembly in System.AppDomain.CurrentDomain.GetAssemblies():
    if assembly.GetName().Name == 'Robots': clr.AddReference(assembly)
import Robots

def unbox(v):
    return v.Value if hasattr(v,'Value') else v

def pattern(value):
    return sorted(set(float(v.strip()) for v in str(value).replace(';',',').split(',') if v.strip()))

import json
midiData=json.loads(str(midijson))
duration = float(bpm)
seconds = max(0.0,min(1.0,float(t))) * duration
beat = seconds
patterns = [midiData['events'][k] for k in ['snare','hat','kick','pedal']]
hatHistory=[v for v in midiData['velocities'] if v['time']<=seconds and (v['role']=='pedal' or v['note'] in [42,46])]
midiOpen=bool(hatHistory and max(hatHistory,key=lambda v:v['time'])['note']==46)
robots = [unbox(r0),unbox(r1),unbox(r2),unbox(r3)]
points = [Point3d(-350,-100,668),Point3d(660,-50,968),Point3d(0,-460,92),Point3d(550,-380,92)]

heavyTimes = midiData['events']['heavy']
crashTimes = midiData['events']['crash']
def nearestTime(times):
    return min([abs(seconds-v) for v in times]+[100.0])
def ease(v):
    v=max(0.0,min(1.0,v));return v*v*(3-2*v)
rimWeight=ease((nearestTime(heavyTimes)-.16)/.24)
points[0]=Point3d(-350,-100+180*rimWeight,668)
crashWeight=ease((.42-nearestTime(crashTimes))/.26)
points[1]=Point3d(660+160*crashWeight,-50+380*crashWeight,968+115*crashWeight)

pedalDistance=min([abs(beat-v) for v in patterns[3]]+[1.0])
points[1].Z += 4.0 if midiOpen else 0.0
meshes=[]; paths=[]; errors=[]; contacts=[]
for i,robot in enumerate(robots):
    events = [v for v in patterns[i]]
    # At contact: z=0. Between contacts: smooth half-cosine rebound.
    distance = min([abs(beat-v) for v in events]+[1.0])
    phase = min(1.0,distance / (0.115 if i<2 else 0.16))
    lift = (48.0 if i<2 else 8.0 if i==3 else 28.0) * (0.5-0.5*math.cos(math.pi*phase))
    roles=[['snare','rim'],['hat','crash'],['kick'],['pedal']][i]
    hits=[v for v in midiData['velocities'] if v['role'] in roles]
    velocity=min(hits,key=lambda v:abs(seconds-v['time']))['velocity'] if hits else 64
    strength=.45+.55*velocity/127.0
    lift*=strength
    if i==3:lift=8.0 if midiOpen else 0.0
    p = points[i] + Vector3d(0,0,lift)
    length = 300.0 if i<2 else 100.0
    toolMesh=Mesh.CreateFromCylinder(Cylinder(Circle(Plane.WorldXY,7 if i<2 else 20),length),1,16)
    cap=Mesh.CreateFromSphere(Sphere(Point3d(0,0,length),8 if i<2 else 24),12,8)
    toolMesh.Append(cap)
    tool=Robots.Tool(Plane(Point3d(0,0,length),Vector3d.ZAxis),'Stick' if i<2 else 'PedalPress',0.15,None,toolMesh)
    if i<2:
        # Hold a virtual wrist pivot; rotate the stick through an arc.
        # Contact is 41 degrees from vertical, rebound is 61 degrees.
        strikeAngle=0.72+(0.76*rimWeight if i==0 else 0.0)
        swing=((0.36-0.29*rimWeight) if i==0 else 0.24)*(0.5-0.5*math.cos(math.pi*phase))
        swing*=strength
        direction=Vector3d(0,math.sin(strikeAngle+swing),-math.cos(strikeAngle+swing))
        contactDirection=Vector3d(0,math.sin(strikeAngle),-math.cos(strikeAngle))
        wrist=points[i]-contactDirection*length
        p=wrist+direction*length
        targetPlane=Plane(p,Vector3d.XAxis,Vector3d.CrossProduct(direction,Vector3d.XAxis))
    else:
        targetPlane=Plane(p,Vector3d.XAxis,-Vector3d.YAxis)
    target=Robots.CartesianTarget(targetPlane,None,Robots.Motions.Linear,tool)
    solutions=robot.Kinematics(System.Array[Robots.Target]([target]))
    poser=Robots.RhinoMeshPoser(robot)
    poser.Pose(solutions,System.Array[Robots.Tool]([tool]))
    colors=[Color.FromArgb(32,45,54),Color.FromArgb(26,139,150),Color.FromArgb(180,198,208),Color.FromArgb(180,198,208),Color.FromArgb(26,139,150),Color.FromArgb(26,139,150),Color.FromArgb(90,112,121),Color.FromArgb(240,166,80)]
    for j,m in enumerate(poser.Meshes):
        if m is not None:
            m.VertexColors.CreateMonotoneMesh(colors[min(j,7)])
            meshes.append(m)
    errors.extend(['Arm '+str(i+1)+': '+str(e) for e in solutions[0].Errors])
    contacts.append(lift)
    paths.append(LineCurve(points[i],points[i]+Vector3d(0,0,48 if i<2 else 28)))
status = 'MIDI / FOUR ARM STUDY\nTime {0:.2f} / {1:.2f} seconds\nIK errors: {2}\nVelocity scales rebound; hardware dynamics unverified.'.format(seconds,duration,len(errors))

# Pedal mechanisms are driven by the same contact heights as their arms.
def append_brep(b,color):
    for m in Mesh.CreateFromBrep(b,MeshingParameters.FastRenderMesh):
        m.VertexColors.CreateMonotoneMesh(color);meshes.append(m)
for x,y,lift in [(0,-460,contacts[2]),(550,-380,contacts[3])]:
    b=Box(Plane.WorldXY,Interval(x-46,x+46),Interval(y-100,y+100),Interval(50,68)).ToBrep()
    # Match the presser's center height while rotating about the rear hinge.
    angle=math.atan2(lift,100.0)
    b.Transform(Transform.Rotation(angle,Vector3d.XAxis,Point3d(x,y-100,59)))
    append_brep(b,Color.FromArgb(175,190,199))
# Kick linkage: the beater swings toward the drum as the pedal descends.
end=Point3d(0,-230-contacts[2]*2.1,285)
start=Point3d(0,-350,55);direction=end-start
append_brep(Cylinder(Circle(Plane(start,direction),9),direction.Length).ToBrep(True,True),Color.FromArgb(180,195,205))
append_brep(Sphere(end,32).ToBrep(),Color.FromArgb(224,219,200))
# Hi-hat top plate opens 0..14 mm as its pedal arm releases.
z=957+contacts[3]*.5
profile=PolylineCurve([Point3d(550+r,-50,z+h) for r,h in [(0,27),(35,30),(62,11),(180,0),(180,-3),(62,6),(35,24),(0,22)]])
append_brep(RevSurface.Create(profile,Line(Point3d(550,-50,z-50),Point3d(550,-50,z+60)),0,2*math.pi).ToBrep(),Color.FromArgb(185,131,48))
# ---------- end midi_four_arm_solver ----------
internal_stage_geometry = Geometry([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])
animated_robots = Geometry(midi_four_arm_solver.meshes)
panel = Panel(midi_four_arm_solver.status)
